# Grasshopper definition gen_dataset_from_obj.gh (Grasshopper 1.0.7)
# plug-ins: Bifocals

number_slider = Slider(1000, range=0..1000)
python = GhPythonScript(seed=number_slider)  # -> out
# ---------- python: Python ----------
__author__ = "Petingo"
__version__ = "2022.06.02"

import random
import rhinoscriptsyntax as rs

random.seed = seed

w = max(random.random(), 0.3) * 50  # max width
vh = random.random() * 30 # max volume height
rh = random.random() * 30 # max roof height
length = max(random.random(), 0.3) * 50

points = []

points.append(rs.AddPoint(0, 0, 0))
points.append(rs.AddPoint(0, w, 0))

roof_points = []

for i in range(5):
    roof_points.append([0, random.random() * w, random.random() * rh + vh])

roof_points[0][1] = 0
roof_points[-1][1] = w

roof_points.sort(reverse=True, key=lambda x: x[1])

for i, p in enumerate(roof_points):
    roof_points[i] = rs.AddPoint(p)

points = points + roof_points
points.append(rs.AddPoint(0, 0, 0))

bounding_edge = rs.AddPolyline(points)

extrude_path = rs.AddLine([0, 0, 0], [length, 0, 0])
house_model = rs.ExtrudeCurve(bounding_edge, extrude_path)

rs.CapPlanarHoles(house_model)

rs.DeleteObjects(points + [bounding_edge])

bbox = rs.BoundingBox(house_model)

center = (bbox[0] + bbox[6]) * 0.5

rs.MoveObject(house_model, -center)

out = house_model
# ---------- end python ----------

object_baker = GhPythonScript(trigger=python, model_id=number_slider, model_id_shift="3000")  # -> out; inputs model_id: Int32, model_id_shift: Int32
# ---------- object_baker: Python ----------
"""
A grasshopper python script that takes photo from different angle (randomly decided)

input:
    - model_id
    - model_id_shift : model_id = model_id + model_id_shift, can be none
"""

import Rhino
import System
import scriptcontext as sc
import rhinoscriptsyntax as rs

import os
import math
import json
import random

if model_id_shift is not None:
    model_id = model_id + model_id_shift

SKETCHES_PER_MODEL = 20

EXPORT_W = 512
EXPORT_H = 512

CAM_DISTANCE = 400

SIDE_VIEW_PORTION = 0.35

DATASET_ROOT = "C:\\Users\\Petingo\\Downloads\\Building-Dataset-Generator"

EXPORT_ROOT = os.path.join(DATASET_ROOT, "Simple-House-v2\\{model_id}")
EXPORT_MODEL_FILENAME = os.path.join(EXPORT_ROOT, "model.obj")
EXPORT_SKETCH_PATH = os.path.join(EXPORT_ROOT, "sketches")
EXPORT_SKETCH_FILENAME = os.path.join(EXPORT_SKETCH_PATH, "render_{sketch_id}.png")

EXPORT_VIEW_TXT_FILENAME = os.path.join(EXPORT_ROOT, "view.txt")

EXPORT_MODEL_PARAM_FILENAME = os.path.join(EXPORT_ROOT, "model_param.json")


# ------------------------------------------------------------------------------------------------- #
# Utility functions
# ------------------------------------------------------------------------------------------------- #

def export_obj_v7():
    """
    This one only works for Rhino v7
    """
    export_filename = EXPORT_MODEL_FILENAME.format(model_id = model_id)
    write_options = Rhino.FileIO.FileWriteOptions()
    write_options.SuppressDialogBoxes = True
    write_options.SuppressAllInput = True # This one doesn't work in V6
     
    obj_options = Rhino.FileIO.FileObjWriteOptions(write_options)
    obj_options.MapZtoY = True
    
    Rhino.FileIO.FileObj.Write(export_filename, Rhino.RhinoDoc.ActiveDoc, obj_options)

def export_obj(filename):
    EXPORT_CMD = "_SelAll _-Export {filename} _Enter _Enter _SelNone".format(filename = filename)
    rs.Command(EXPORT_CMD)

# Ref: https://destevez.net/2018/11/projection-of-a-sphere-onto-the-unit-sphere-in-spherical-coordinates/
def spherical_to_Point3d(azimuth, elevation, radius=1):
    a = math.radians(azimuth)
    e = math.radians(elevation)
    
    x = radius * math.cos(a) * math.cos(e)
    y = radius * math.sin(a) * math.cos(e)
    z = radius * math.sin(e)
    
    return Rhino.Geometry.Point3d(x, y, z)

# ------------------------------------------------------------------------------------------------- #
# Main Script
# ------------------------------------------------------------------------------------------------- #

if not os.path.exists(EXPORT_SKETCH_PATH.format(model_id=model_id)):
    os.makedirs(EXPORT_SKETCH_PATH.format(model_id=model_id))

export_obj(EXPORT_MODEL_FILENAME.format(model_id = model_id))

with open(EXPORT_VIEW_TXT_FILENAME.format(model_id=model_id), 'w') as view_txt:
    for sketch_id in range(SKETCHES_PER_MODEL):
        azimuth = random.randint(0, 90) + 90 * random.randint(0, 3)
        if azimuth > 180:
            azimuth = azimuth - 360 # 181 => -179

        # side view
        if random.random() < SIDE_VIEW_PORTION:
            elevation = random.randint(0, 15)
        # other perspective
        else:
            elevation = random.randint(-15, 60)
            
        # In view.txt:
        # azimuth elevation 0 distance
        # view_txt.write("{a} {e} 0 {d}\n".format(a=azimuth, e=elevation, d=CAM_DISTANCE))
        view_txt.write("{a} {e} 0 {d}\n".format(a=azimuth, e=elevation, d=2.0)) # set the same as the ref dataset
        
        targetLocation = Rhino.Geometry.Point3d(0, 0, 0) # center_point
        cameraLocation = spherical_to_Point3d(azimuth, elevation, CAM_DISTANCE)
        
        viewport = sc.doc.Views.ActiveView.ActiveViewport
        viewport.SetCameraLocations(targetLocation, cameraLocation)
        
        # TODO: check Size() constructor
        image = sc.doc.Views.ActiveView.CaptureToBitmap(System.Drawing.Size(EXPORT_W, EXPORT_H), Rhino.Display.DisplayModeDescription.GetDisplayMode(Rhino.Display.DisplayModeDescription.TechId))
        image.Save(EXPORT_SKETCH_FILENAME.format(model_id = model_id, sketch_id = sketch_id))


# Delete everything afterward
rs.Command("_SelAll _Delete")
# ---------- end object_baker ----------
panel = Panel("Renderer")
