# Grasshopper definition house2.gh (Grasshopper 1.0.7)
# plug-ins: Bifocals

number_slider = Slider(1000, range=0..1000)
python = GhPythonScript(seed=number_slider)  # -> roof_x1, roof_x2, roof_y1, roof_y2, house_wx, house_wy, house_height, roof_height
# ---------- python: Python ----------
__author__ = "Petingo"
__version__ = "2022.05.17"

import rhinoscriptsyntax as rs
import random

random.seed(seed)

roof_x1 = random.random() * 50
roof_x2 = random.random() * 50
roof_y1 = random.random() * 50
roof_y2 = random.random() * 50
house_wx = max(random.random(), 0.2) * 50
house_wy = max(random.random(), 0.2) * 50
house_height = random.random() * 50
roof_height = random.random() * 50

roof_type_indicator = random.random()

#if roof_type_indicator < 0.66:
roof_x1 = 1e-3
roof_x2 = 1e-3
    
#if roof_type_indicator < 0.33:
roof_y1 = 1e-3
roof_y2 = 1e-3

if roof_x1 > house_wx / 2:
    roof_x1 = house_wx / 2

if roof_x2 > house_wx / 2:
    roof_x2 = house_wx / 2

if roof_y1 > house_wy / 2:
    roof_y1 = house_wy / 2

if roof_y2 > house_wy / 2:
    roof_y2 = house_wy / 2
# ---------- end python ----------
dom = ConstructDomain(DomainStart=expr("-x", python.house_wx), DomainEnd=python.house_wx)
dom_2 = ConstructDomain(DomainStart=expr("-x", python.house_wy), DomainEnd=python.house_wy)
rectangle = Rectangle(Plane=PlaneXY(0, 0, 0), XSize=dom, YSize=dom_2, Radius=0)  # -> Rectangle, Length
Z = UnitZ(Factor=python.house_height)
Z_2 = UnitZ(Factor=python.roof_height)
dom_3 = ConstructDomain(DomainStart=expr("-x", python.roof_y1), DomainEnd=python.roof_y2)
dom_4 = ConstructDomain(DomainStart=expr("-x", python.roof_x1), DomainEnd=python.roof_x2)
extr = Extrude(Base=rectangle.Rectangle, Direction=Z)
addition = Addition(A=Z, B=Z_2)
rectangle_2 = Rectangle(Plane=PlaneXY(0, 0, 0), XSize=dom_4, YSize=dom_3, Radius=0)  # -> Rectangle, Length
move = Move(Geometry=rectangle.Rectangle, Motion=Z)  # -> Geometry, Transform
move_2 = Move(Geometry=rectangle_2.Rectangle, Motion=addition)  # -> Geometry, Transform
merge = Merge(Data1=move.Geometry, Data2=move_2.Geometry)
loft = Loft(Curves=merge, Options={Adjust=False, Closed=False, LoftEnds=0, LoftSimp=0, LoftType=0, Rebuild=10, Refit=0.01})
merge_2 = Merge(Data1=loft, Data2=extr)
join = BrepJoin(Breps=merge_2)  # -> Breps, Closed
cap = CapHoles(Brep=join.Breps)

bbox = BoundingBox(Content=cap, Plane=PlaneXY(0, 0, 0))  # -> Box, Box_2
box_corners = BoxCorners(Box=bbox.Box)  # -> CornerA, CornerB, CornerC, CornerD, CornerE, CornerF, CornerG, CornerH
avr = Average(Input=[box_corners.CornerA, box_corners.CornerB, box_corners.CornerC, box_corners.CornerD, box_corners.CornerE, box_corners.CornerF, box_corners.CornerG, box_corners.CornerH])
multiplication = Multiplication(A=avr, B="-1")
move_3 = Move(Geometry=cap, Motion=multiplication)  # -> Geometry, Transform

preview = CustomPreview(
    Geometry=move_3.Geometry,
    Material={diffuse=RGB(221, 160, 221), emission=RGB(66, 48, 66), shine=0.5, specular=RGB(255, 255, 255), transparency=0})
brep = Brep(move_3.Geometry)

panel = Panel("Object Baker")
object_baker = GhPythonScript(obj=brep)  # -> out; inputs obj: GeometryBase
# ---------- object_baker: Python ----------
import scriptcontext as sc
import System.Drawing as sd
import Rhino.DocObjects as rd
import Rhino.Geometry as rg
import Rhino

attr = rd.ObjectAttributes()

sc.doc = Rhino.RhinoDoc.ActiveDoc

type = obj.ObjectType
if type == rd.ObjectType.Point:
    sc.doc.Objects.AddPoint(obj.Location, attr)
elif type == rd.ObjectType.Curve:
    sc.doc.Objects.AddCurve(obj, attr)
elif type == rd.ObjectType.Surface:
    sc.doc.Objects.AddSurface(obj, attr)
elif type == rd.ObjectType.Brep:
    sc.doc.Objects.AddBrep(obj, attr)
elif type == rd.ObjectType.Mesh:
    sc.doc.Objects.AddMesh(obj, attr)
else:
    print "object type "+str(type)+ " is not baked"
# ---------- end object_baker ----------

object_baker_2 = GhPythonScript(trigger=object_baker, model_id=number_slider, model_id_shift="2000")  # -> out; inputs model_id: Int32, model_id_shift: Int32
# ---------- object_baker_2: Python ----------
"""
A grasshopper python script that takes photo from different angle (randomly decided)

input:
    - model_id
    - model_id_shift : model_id = model_id + model_id_shift, can be none
"""

import Rhino
import System
import scriptcontext as sc
import rhinoscriptsyntax as rs

import os
import math
import json
import random

if model_id_shift is not None:
    model_id = model_id + model_id_shift

SKETCHES_PER_MODEL = 20

EXPORT_W = 512
EXPORT_H = 512

CAM_DISTANCE = 400

SIDE_VIEW_PORTION = 0.35

DATASET_ROOT = "C:\\Users\\Petingo\\Downloads\\Building-Dataset-Generator"

EXPORT_ROOT = os.path.join(DATASET_ROOT, "Simple-House-v2\\{model_id}")
EXPORT_MODEL_FILENAME = os.path.join(EXPORT_ROOT, "model.obj")
EXPORT_SKETCH_PATH = os.path.join(EXPORT_ROOT, "sketches")
EXPORT_SKETCH_FILENAME = os.path.join(EXPORT_SKETCH_PATH, "render_{sketch_id}.png")

EXPORT_VIEW_TXT_FILENAME = os.path.join(EXPORT_ROOT, "view.txt")

EXPORT_MODEL_PARAM_FILENAME = os.path.join(EXPORT_ROOT, "model_param.json")


# ------------------------------------------------------------------------------------------------- #
# Utility functions
# ------------------------------------------------------------------------------------------------- #

def export_obj_v7():
    """
    This one only works for Rhino v7
    """
    export_filename = EXPORT_MODEL_FILENAME.format(model_id = model_id)
    write_options = Rhino.FileIO.FileWriteOptions()
    write_options.SuppressDialogBoxes = True
    write_options.SuppressAllInput = True # This one doesn't work in V6
     
    obj_options = Rhino.FileIO.FileObjWriteOptions(write_options)
    obj_options.MapZtoY = True
    
    Rhino.FileIO.FileObj.Write(export_filename, Rhino.RhinoDoc.ActiveDoc, obj_options)

def export_obj(filename):
    EXPORT_CMD = "_SelAll _-Export {filename} _Enter _Enter _SelNone".format(filename = filename)
    rs.Command(EXPORT_CMD)

# Ref: https://destevez.net/2018/11/projection-of-a-sphere-onto-the-unit-sphere-in-spherical-coordinates/
def spherical_to_Point3d(azimuth, elevation, radius=1):
    a = math.radians(azimuth)
    e = math.radians(elevation)
    
    x = radius * math.cos(a) * math.cos(e)
    y = radius * math.sin(a) * math.cos(e)
    z = radius * math.sin(e)
    
    return Rhino.Geometry.Point3d(x, y, z)

# ------------------------------------------------------------------------------------------------- #
# Main Script
# ------------------------------------------------------------------------------------------------- #

if not os.path.exists(EXPORT_SKETCH_PATH.format(model_id=model_id)):
    os.makedirs(EXPORT_SKETCH_PATH.format(model_id=model_id))

export_obj(EXPORT_MODEL_FILENAME.format(model_id = model_id))

with open(EXPORT_VIEW_TXT_FILENAME.format(model_id=model_id), 'w') as view_txt:
    for sketch_id in range(SKETCHES_PER_MODEL):
        azimuth = random.randint(0, 90) + 90 * random.randint(0, 3)
        if azimuth > 180:
            azimuth = azimuth - 360 # 181 => -179

        # side view
        if random.random() < SIDE_VIEW_PORTION:
            elevation = random.randint(0, 15)
        # other perspective
        else:
            elevation = random.randint(-15, 60)
            
        # In view.txt:
        # azimuth elevation 0 distance
        # view_txt.write("{a} {e} 0 {d}\n".format(a=azimuth, e=elevation, d=CAM_DISTANCE))
        view_txt.write("{a} {e} 0 {d}\n".format(a=azimuth, e=elevation, d=2.0)) # set the same as the ref dataset
        
        targetLocation = Rhino.Geometry.Point3d(0, 0, 0) # center_point
        cameraLocation = spherical_to_Point3d(azimuth, elevation, CAM_DISTANCE)
        
        viewport = sc.doc.Views.ActiveView.ActiveViewport
        viewport.SetCameraLocations(targetLocation, cameraLocation)
        
        # TODO: check Size() constructor
        image = sc.doc.Views.ActiveView.CaptureToBitmap(System.Drawing.Size(EXPORT_W, EXPORT_H), Rhino.Display.DisplayModeDescription.GetDisplayMode(Rhino.Display.DisplayModeDescription.TechId))
        image.Save(EXPORT_SKETCH_FILENAME.format(model_id = model_id, sketch_id = sketch_id))


# Delete everything afterward
rs.Command("_SelAll _Delete")
# ---------- end object_baker_2 ----------
panel_2 = Panel("Renderer")
